# Grasshopper definition Subscriber_Bengesht.gh (Grasshopper 1.0.7)

# ---- group: Connect Client
websocket_client_start = WebsocketClientStart(Address="ws://localhost:9090/", InitalMessage="Hello World", Reset=Button())

# ---- group: Topic To Subscribe
subscribe = Subscribe(Topic="/chatter")  # -> R
# ---------- subscribe: Python ----------
import json


data = {
"op":"subscribe",
"topic":Topic
}

R = json.dumps(data)
# ---------- end subscribe ----------
websocket_client_sender = WebsocketClientSender(WebsocketObjects=websocket_client_start, Message=subscribe)

# ---- group: Subscriber
websocket_client_receiver = WebsocketClientReceiver(WebsocketObjects=websocket_client_start, AutoUpdate=True)  # -> Message, Status
rec = DataRecorder(websocket_client_receiver.Message, DataLimit=-10, RecordData=False)
panel = Panel(rec)

# ---- group: Parse String
parse_string = ParseString(M=rec)  # -> data
# ---------- parse_string: Python ----------
import json

try:
    jsonObj = json.loads(M)["msg"];
    
    data = jsonObj["data"]
except:
    data = None
# ---------- end parse_string ----------
panel_2 = Panel(parse_string)
