# Grasshopper definition Subscriber_CompasFab.gh (Grasshopper 1.0.7)

# ---- group: Connect Client
python = GhPythonScript(connect=Toggle(True))  # -> out, client
# ---------- python: Python ----------
from compas_fab.backends import RosClient

client = RosClient()

if connect is True:
    client.run()
    print('Connected: ', client.is_connected)
    
elif connect is False:
    client.close()
# ---------- end python ----------

# ----
panel = Panel(python.out)

# ---- group: Subscriber
python_2 = GhPythonScript(client=python.client, topic="/chatter", msg_type="std_msgs/String", read=Toggle(False))  # -> out, a
# ---------- python_2: Python ----------
import time

from roslibpy import Topic
from compas_fab.backends import RosClient


def receive_message(message):
    print('Heard talking: ' + message['data'])


with RosClient() as client:
    listener = Topic(client, topic, msg_type)


    if read and client.is_connected:
        listener.subscribe(receive_message)
# ---------- end python_2 ----------

# ----
panel_2 = Panel(python_2.out)
