# Grasshopper definition Turtlesim.gh (Grasshopper 1.0.7)
# plug-ins: Human

# ---- group: Connect Client
# CLIENT
toggle = BooleanToggle(True)
python = GhPythonScript(toggle=toggle)  # -> log
# ---------- python: Python ----------
from compas_fab.backends import RosClient
import scriptcontext as rs

client = RosClient()

try:
    client.run()
    print('Connected: ', client.is_connected)
    rs.sticky["Client"] = client
except:
    print('Not Connected')
# ---------- end python ----------
panel = Panel(python)

# ---- group: ROS Topic List
# ROS TOPIC
python_2 = GhPythonScript()  # -> topics
# ---------- python_2: Python ----------
import roslibpy
import scriptcontext as rs

client = rs.sticky["Client"]
topics = client.get_topics()
# ---------- end python_2 ----------
panel_2 = Panel(python_2)

# ---- group: ROS Nodes List
# ROS SERVICE
python_3 = GhPythonScript()  # -> nodes
# ---------- python_3: Python ----------
import roslibpy
import scriptcontext as rs

client = rs.sticky["Client"]
nodes = client.get_nodes()
# ---------- end python_3 ----------
panel_3 = Panel(python_3)

# ---- group: Node Details
list = ItemSelector(panel_3, {"/turtlesim", "/rosapi", "/rosbridge_websocket", "/rosout"}, selected="/turtlesim")
python_4 = GhPythonScript(node=list)  # -> subscribing, publishing, services
# ---------- python_4: Python ----------
import roslibpy
import scriptcontext as rs

client = rs.sticky["Client"]
details = client.get_node_details(node)
subscribing = details['subscribing']
publishing = details['publishing']
services = details['services']
# ---------- end python_4 ----------
panel_4 = Panel(python_4.publishing)
panel_5 = Panel(python_4.subscribing)
panel_6 = Panel(python_4.services)

# ---- group: Service Request
list_2 = ItemSelector(
    panel_6,
    {"/clear", "/kill", "/reset", "/spawn", "/turtle1/set_pen", "/turtle1/teleport_absolute", "/turtle1/teleport_relative", "/turtlesim/get_loggers", "/turtlesim/set_logger_level"}, selected="/turtle1/set_pen")
python_5 = GhPythonScript(service=list_2)  # -> service_type
# ---------- python_5: Python ----------
import roslibpy
import scriptcontext as rs

client = rs.sticky["Client"]
service_type = client.get_service_type(service)
# ---------- end python_5 ----------
panel_7 = Panel(python_5)
python_6 = GhPythonScript(service=list_2, service_type=python_5, call=Button())  # -> out
# ---------- python_6: Python ----------
import roslibpy
import scriptcontext as rs

client = rs.sticky["Client"]

if call:
    service = roslibpy.Service(client, service, service_type)
    request = roslibpy.ServiceRequest()
    result = service.call(request)
    print('Calling service...')
    print(result)
# ---------- end python_6 ----------

# ---- group: Publish Message
list_3 = ItemSelector(
    panel_2,
    {"/turtle1/color_sensor", "/client_count", "/rosout", "/rosout_agg", "/connected_clients", "/turtle1/cmd_vel", "/turtle1/pose"}, selected="/turtle1/cmd_vel")
number_slider = Slider(1, range=0..1)
pi = Pi(Factor=Slider(0.3, range=-0.5..0.5))
python_7 = GhPythonScript(topic=list_3)  # -> msg_type
# ---------- python_7: Python ----------
import roslibpy
import scriptcontext as rs

client = rs.sticky["Client"]
msg_type = client.get_topic_type(topic)
# ---------- end python_7 ----------
panel_8 = Panel(python_7)
trigger = Trigger(Interval=1000, TimerInterval=1000, Target=python_9)  # disabled

# ---- group: Publish Message / Twist Message
python_8 = GhPythonScript(LX=number_slider, AZ=pi)  # -> M
# ---------- python_8: Python ----------
import json

message = {"angular":{"x":(AX or 0), "y":(AY or 0), "z":(AZ or 0)}, "linear":{"x":(LX or 0), "y":(LY or 0), "z":(LZ or 0)}}

M = json.dumps(message)
# ---------- end python_8 ----------

# ---- group: Publish Message (continued)
panel_9 = Panel(python_8)
python_9 = GhPythonScript(topic=list_3, msg_type=python_7, message=python_8)  # -> out
# ---------- python_9: Python ----------
from roslibpy import Message
from roslibpy import Topic
import scriptcontext as rs
import json

client = rs.sticky["Client"]

message = json.loads(message)

publisher = Topic(client, topic, msg_type)
publisher.publish(Message(message))

print('Sending message...')
# ---------- end python_9 ----------
panel_10 = Panel(python_9)
